# Grasshopper definition test.gh (Grasshopper 0.9.76)
# plug-ins: MeshEdit Components, Circulation

geo = Geometry(<curve referenced from the Rhino model>)
pt = Point(Point(5.237058645, 4.017853587, 0))
geo_2 = Geometry(<curve referenced from the Rhino model>)
node = Node(Position=pt, Name=pt, Floor="FLOOR")
floor = Floor(Boundary=geo, Name="FLOOR")
barrier = Barrier(Boundary=geo_2, Floor="FLOOR")
agent = Agent(Name=pt, Origin=pt, Destination=pt)
env = Environment(Entities=[floor, node, agent, barrier], Resolution=Slider(1, range=0..1), Run=Toggle(False))
bmap = BarrierMap(Environment=env, FloorName="FLOOR")  # -> Mesh, Values
gradient = Gradient(
    LowerLimit=0,
    UpperLimit=Slider(8, range=0..10),
    Parameter=bmap.Values,
    stops=[0: RGB(0, 128, 0), 0.5: RGB(255, 255, 0), 1: RGB(255, 0, 0)])
explode = MeshExplode(Mesh=bmap.Mesh, Interpolate=False)
preview = CustomPreview(Geometry=explode, Shader=gradient)
